# Grasshopper definition load_urdf_loacally.gh (Grasshopper 1.0.8)
# plug-ins: RhinoCodePluginGH

md_slider = MDSlider(
    SliderMode=0,
    slider_value=Point(0.5719537502, 0.4526523497, 0.5),
    x_domain=Domain(0, 1),
    y_domain=Domain(0, 1),
    z_domain=Domain(0, 1))
surface = Surface(<surface referenced from the Rhino model>)
evaluate_surface = EvaluateSurface(Surface=reparameterize(surface), Point=md_slider)  # -> Point, Normal, UDirection, VDirection, Frame

# ----
# Input
panel = Panel("Start plane")
pt = Point(Point(2.383125328, 5.828241913, 0))
py = GhPythonScript(pt=pt)  # -> pln
# ---------- py: Python ----------
import Rhino.Geometry as rg

pln = rg.Plane(pt, -rg.Vector3d.ZAxis)
# ---------- end py ----------
end_plane = Plane(evaluate_surface.Frame)
start_plane = Plane(py)

scale = Scale(Geometry=evaluate_surface.Frame, Center=Point(0, 0, 0), Factor="0.001")  # -> Geometry, Transform
vector_display_ex = VectorDisplayEx(Point=evaluate_surface.Point, Vector=evaluate_surface.Normal, Colour=RGB(0, 0, 0), Width="1")
list = ValueList({"don't use attached collision mesh": 0, "use attached collision mesh": 1}, selected="use attached collision mesh")
robot_visualize = RobotVisualize()  # -> visual, collision, collision_meshes, attached_meshes, frames, base_frame, ee_frame; inputs group: String, show_visual: Boolean, show_collision: Boolean, show_frames: Boolean, show_base_frame: Boolean, show_end_effector_frame: Boolean, show_cm: Boolean, show_acm: Boolean
#   port group: The planning group used for end-effector and base visualization.
#   port configuration: The robot's full configuration.
#   port show_visual: Whether or not to show the robot's visual meshes.
#   port show_collision: Whether or not to show the robot's collision meshes.
#   port show_frames: Whether or not to show the robot's joint frames.
#   port show_base_frame: Whether or not to show the robot's base frame.
#   port show_end_effector_frame: Whether or not to show the robot's end-effector frame.
#   port show_cm: Whether or not to show the collision meshes (if any).
#   port show_acm: Whether or not to show the attached collision meshes (if any).
#   port visual: Rhino meshes of the robot's visual geometry (if any).
#   port collision: Rhino meshes of the robot's collision geometry (if any).
#   port collision_meshes: Rhino meshes of the scene's collision meshes (if any).
#   port attached_meshes: Rhino meshes of the scene's attached collision meshes (if any).
#   port frames: The robot's joint frames as Rhino planes (if any).
#   port base_frame: The robot's base frame as a Rhino plane (if any).
#   port ee_frame: The robot's end-effector frame as a Rhino plane (if any).
# ---------- robot_visualize: Python ----------
"""
Visualizes the robot.

COMPAS FAB v1.0.2
"""

import time

from compas.geometry import Frame
from compas.geometry import Transformation
from compas.scene import SceneObject
from compas_fab.ghpython.components import create_id
from compas_rhino.conversions import frame_to_rhino_plane
from ghpythonlib.componentbase import executingcomponent as component
from scriptcontext import sticky as st

from compas_fab.backends import BackendFeatureNotSupportedError
from compas_fab.robots import PlanningScene


class RobotVisualize(component):
    def RunScript(self,
            robot,
            group: str,
            configuration,
            show_visual: bool,
            show_collision: bool,
            show_frames: bool,
            show_base_frame: bool,
            show_end_effector_frame: bool,
            show_cm: bool,
            show_acm: bool):
        visual = None
        collision = None
        collision_meshes = None
        attached_meshes = None
        frames = None
        base_frame = None
        ee_frame = None

        if robot:
            show_visual = True if show_visual is None else show_visual
            show_cm = True if show_cm is None else show_cm
            show_acm = True if show_acm is None else show_acm
            configuration = configuration or robot.zero_configuration()

            robot.update(configuration, visual=show_visual, collision=show_collision)
            compas_frames = robot.transformed_frames(configuration, group)

            if show_visual:
                visual = robot.scene_object.draw_visual()

            if show_collision:
                collision = robot.scene_object.draw_collision()

            if show_base_frame:
                base_compas_frame = compas_frames[0]
                base_frame = frame_to_rhino_plane(base_compas_frame)

            if show_end_effector_frame:
                options = dict(solver="model")
                if robot.attached_tool:
                    options["link"] = robot.attached_tool.connected_to

                ee_compas_frame = robot.forward_kinematics(configuration, group, options=options)
                ee_frame = frame_to_rhino_plane(ee_compas_frame)

            if show_frames:
                frames = []
                for compas_frame in compas_frames[1:]:
                    frame = frame_to_rhino_plane(compas_frame)
                    frames.append(frame)

            cached_scene_key = create_id(self, "cached_scene")

            if show_cm or show_acm:
                cached_scene = st.get(cached_scene_key)
                if not cached_scene:
                    cached_scene = {"time": 0}

                # expire cache if the component has not been executed in the last 2 seconds
                # this allows to slide through a list of configurations
                # without triggering refreshes of the scene in the middle of it
                if time.time() - cached_scene["time"] > 2:
                    update_scene = True
                else:
                    update_scene = False

                if update_scene:
                    scene = PlanningScene(robot)
                    try:
                        scene = robot.client.get_planning_scene()
                    except BackendFeatureNotSupportedError:
                        print(
                            "The selected backend does not support collision meshes. If you need collision mesh support, use a different backend."
                        )
                        scene = None
                        show_cm = False
                        show_acm = False

                if update_scene and show_cm:
                    collision_meshes = []

                    for co in scene.world.collision_objects:
                        header = co.header
                        frame_id = header.frame_id
                        cms = co.to_collision_meshes()

                        for cm in cms:
                            if cm.frame != Frame.worldXY():
                                t = Transformation.from_frame(cm.frame)
                                mesh = cm.mesh.transformed(t)
                            else:
                                mesh = cm.mesh

                            collision_meshes.extend(SceneObject(item = mesh).draw())

                        cached_scene["cm"] = collision_meshes

                collision_meshes = cached_scene.get("cm", [])

                if update_scene and show_acm:
                    attached_meshes = []

                    for aco in scene.robot_state.attached_collision_objects:
                        for acm in aco.to_attached_collision_meshes():
                            frame_id = aco.object["header"]["frame_id"]
                            frame = robot.forward_kinematics(configuration, options=dict(link=frame_id))
                            t = Transformation.from_frame(frame)

                            # Local CM frame
                            if acm.collision_mesh.frame and acm.collision_mesh.frame != Frame.worldXY():
                                t = t * Transformation.from_frame(acm.collision_mesh.frame)

                            mesh = acm.collision_mesh.mesh.transformed(t)

                            attached_meshes.extend(SceneObject(item = mesh).draw())

                    cached_scene["acm"] = attached_meshes

                attached_meshes = cached_scene.get("acm", [])

                cached_scene["time"] = time.time()
                st[cached_scene_key] = cached_scene

        return (
            visual,
            collision,
            collision_meshes,
            attached_meshes,
            frames,
            base_frame,
            ee_frame,
        )
# ---------- end robot_visualize ----------
panel_2 = Panel("C:\Users\lichao\autonomous-excavator\ExcavatorCADFiles\URDF_MathScavator9000_flat\MathScavator9000_flat")
number_slider = Slider(0.01, range=0..0.01)
boolean_toggle = BooleanToggle(True)
avoid_collisions = BooleanToggle(True)
# Plan cartesian motion
py_2 = PythonScript(start_plane=start_plane, end_plane=end_plane)  # -> planes
# ---------- py_2: Python ----------
planes = [start_plane, end_plane]
print planes
# ---------- end py_2 ----------
compute = Button()
zero_config = ZeroConfig()  # -> config; inputs group: String
#   port group: If assigned, it will return the zero configuration for the given group, otherwise a full zero configuration.
#   port config: The zero configuration.
# ---------- zero_config: Python ----------
"""
Get a zero configuration for a robot.

COMPAS FAB v1.0.2
"""

from ghpythonlib.componentbase import executingcomponent as component


class ConfigZero(component):
    def RunScript(self, robot, group: str):
        if robot:
            return robot.zero_configuration(group)

        return None
# ---------- end zero_config ----------
ros_robot = ROSRobot()  # -> robot; inputs load: Boolean
#   port ros_client: The ROS client.
#   port load: If True, loads the robot from ROS. Defaults to False.
# ---------- ros_robot: Python ----------
"""
Load robot directly from ROS.

COMPAS FAB v1.0.2
"""

from compas.scene import SceneObject
from ghpythonlib.componentbase import executingcomponent as component
from scriptcontext import sticky as st

from compas_fab.ghpython.components import create_id


class ROSRobot(component):
    def RunScript(self, ros_client, load: bool):
        key = create_id(self, "robot")

        if ros_client and ros_client.is_connected and load:
            # Load URDF from ROS
            st[key] = ros_client.load_robot(load_geometry=True, precision=12)
            st[key].scene_object = SceneObject(item = st[key].model)

        robot = st.get(key, None)
        if robot:  # client sometimes need to be restarted, without needing to reload geometry
            robot.client = ros_client
        return robot
# ---------- end ros_robot ----------
S = Script(name="MathScavator9000_flat.SLDASM", package_path=panel_2, load=Toggle(True))  # -> out, robot; inputs name: String, package_path: String, load: Boolean
# ---------- S: Python ----------
"""
Load robot directly from ROS.

COMPAS FAB v1.0.2
"""

from compas.scene import SceneObject
from ghpythonlib.componentbase import executingcomponent as component
from scriptcontext import sticky as st

from compas_fab.ghpython.components import create_id

from compas_robots import RobotModel
from compas_fab.robots import Robot ,RobotSemantics
from compas_robots.resources import LocalPackageMeshLoader

import compas_fab
import os

class ROSRobot(component):
    def RunScript(self, name: str, package_path: str, load: bool):
        key = create_id(self, "robot")
        urdf_file_path = os.path.join(package_path, "urdf\\")
        urdf_file = urdf_file_path + name+ ".urdf"
        srdf_file = urdf_file_path + name+ ".srdf"
        srdf = compas_fab.get(srdf_file)
        urdf = compas_fab.get(urdf_file)
        if urdf and load:
            # Load URDF from local file path
            
            robot_model = RobotModel.from_urdf_file(urdf)
            # Also load geometry
            support_package_name = ""
            loader = LocalPackageMeshLoader(compas_fab.get(package_path), support_package_name)
            robot_model.load_geometry(loader, precision=12)
            #semantics = RobotSemantics.from_srdf_file(srdf, robot_model)
            robot =  Robot(robot_model, scene_object = SceneObject(item = robot_model))
            st[key] = robot
        

        robot = st.get(key, None)
        return robot
# ---------- end S ----------
zero_config_2 = ZeroConfig(robot=S.robot)  # -> config; inputs group: String; same code as zero_config
inverse_kinematics = InverseKinematics(robot=S.robot, plane=start_plane, start_configuration=zero_config_2)  # -> configuration; inputs group: String
#   port plane: The plane or frame to calculate the inverse kinematic for.
#   port start_configuration: If passed, calculates the inverse such that the joint positions differ the least from the start_configuration. Defaults to the zero configuration.
#   port group: The planning group used for calculation. Defaults to the robot's main planning group.
#   port configuration: The planning group's configuration.
# ---------- inverse_kinematics: Python ----------
"""
Calculate the robot's inverse kinematic for a given plane.

COMPAS FAB v1.0.2
"""

from compas_rhino.conversions import plane_to_compas_frame
from ghpythonlib.componentbase import executingcomponent as component


class InverseKinematics(component):
    def RunScript(self, robot, plane, start_configuration, group: str):
        configuration = None
        if robot and robot.client and robot.client.is_connected and plane:
            frame = plane_to_compas_frame(plane)
            configuration = robot.inverse_kinematics(frame,start_configuration= start_configuration,group = group)
        return configuration
# ---------- end inverse_kinematics ----------
filter = StreamFilter(Gate=list)
merge_config = MergeConfig(config_a=inverse_kinematics)  # -> config
#   port config_a: The configuration to use as base for the merge.
#   port config_b: The configuration used to merge into the base one.
#   port config: The merged configuration.
# ---------- merge_config: Python ----------
"""
Merge two configurations.

COMPAS FAB v1.0.2
"""

from ghpythonlib.componentbase import executingcomponent as component


class ConfigMerge(component):
    def RunScript(self, config_a, config_b):
        if config_a and config_b:
            return config_a.merged(config_b)

        return None
# ---------- end merge_config ----------
script = Script()  # -> out, a
# ---------- script: Python ----------
import compas_fab
from compas.geometry import Frame
from compas_fab.backends import PyBulletClient

with PyBulletClient(connection_type='direct') as client:
    urdf_filename = compas_fab.get('robot_library/ur5_robot/urdf/robot_description.urdf')
    robot = client.load_robot(urdf_filename)

    frame_WCF = Frame([0.3, 0.1, 0.5], [1, 0, 0], [0, 1, 0])
    start_configuration = robot.zero_configuration()

    options = dict(max_results=20, high_accuracy_threshold=1e-6, high_accuracy_max_iter=20)
    for config in robot.iter_inverse_kinematics(frame_WCF, start_configuration, options=options):
        print("Found configuration", config)
# ---------- end script ----------
plan_cartesian_motion = PlanCartesianMotion(planes=py_2, start_configuration=zero_config_2, max_step=number_slider, compute=boolean_toggle)  # -> trajectory; inputs planes: list, group: String, attached_collision_meshes: list, path_constraints: list, max_step: Double, compute: Boolean
#   port planes: The planes or frames through which the path is defined.
#   port start_configuration: The robot's full configuration, i.e. values for all configurable joints of the entire robot, at the starting position. Defaults to the all-zero configuration.
#   port group: The planning group used for calculation. Defaults to the robot's main planning group.
#   port attached_collision_meshes: A list of attached collision meshes to be included for planning.
#   port path_constraints: Optional constraints that can be imposed along the solution path. Note that path calculation won't work if the start_configuration violates these constraints. Defaults to None.
#   port max_step: The approximate distance between the calculated points. (Defined in the robot's units.) Defaults to 0.01.
#   port compute: If True, calculates a trajectory.
#   port trajectory: The calculated trajectory.
# ---------- plan_cartesian_motion: Python ----------
"""
Calculate a cartesian motion path (linear in tool space).

COMPAS FAB v1.0.2
"""

from compas_rhino.conversions import plane_to_compas_frame
from ghpythonlib.componentbase import executingcomponent as component
from scriptcontext import sticky as st

from compas_fab.ghpython.components import create_id
from compas_fab.robots import FrameWaypoints

from compas_fab.backends import AnalyticalPlanCartesianMotion


import System


class PlanCartesianMotion(component):
    def RunScript(self,
            robot,
            planes: System.Collections.Generic.List[object],
            start_configuration,
            group: str,
            attached_collision_meshes: System.Collections.Generic.List[object],
            path_constraints: System.Collections.Generic.List[object],
            max_step: float,
            compute: bool):
        key = create_id(self, "trajectory")

        max_step = float(max_step) if max_step else 0.01
        path_constraints = list(path_constraints) if path_constraints else None
        attached_collision_meshes = list(attached_collision_meshes) if attached_collision_meshes else None

        if robot and start_configuration and planes and compute:
            frames = [plane_to_compas_frame(plane) for plane in planes]
            frame_waypoints = FrameWaypoints(frames)
            apcm = AnalyticalPlanCartesianMotion 
            st[key] = apcm.plan_cartesian_motion(
                robot,
                frame_waypoints,
                start_configuration=start_configuration,
                group=group,
                options=dict(
                    max_step=max_step,
                    path_constraints=path_constraints,
                    attached_collision_meshes=attached_collision_meshes,
                ),
            )

        trajectory = st.get(key, None)
        return trajectory
# ---------- end plan_cartesian_motion ----------
plan_cartesian_motion_2 = PlanCartesianMotion(robot=S.robot, planes=py_2, start_configuration=zero_config_2, max_step=number_slider, compute=boolean_toggle)  # -> trajectory; inputs planes: list, group: String, attached_collision_meshes: list, path_constraints: list, max_step: Double, compute: Boolean
#   port planes: The planes or frames through which the path is defined.
#   port start_configuration: The robot's full configuration, i.e. values for all configurable joints of the entire robot, at the starting position. Defaults to the all-zero configuration.
#   port group: The planning group used for calculation. Defaults to the robot's main planning group.
#   port attached_collision_meshes: A list of attached collision meshes to be included for planning.
#   port path_constraints: Optional constraints that can be imposed along the solution path. Note that path calculation won't work if the start_configuration violates these constraints. Defaults to None.
#   port max_step: The approximate distance between the calculated points. (Defined in the robot's units.) Defaults to 0.01.
#   port compute: If True, calculates a trajectory.
#   port trajectory: The calculated trajectory.
# ---------- plan_cartesian_motion_2: Python ----------
"""
Calculate a cartesian motion path (linear in tool space).

COMPAS FAB v1.0.2
"""

from compas_rhino.conversions import plane_to_compas_frame
from ghpythonlib.componentbase import executingcomponent as component
from scriptcontext import sticky as st

from compas_fab.ghpython.components import create_id
from compas_fab.robots import FrameWaypoints

import System


class PlanCartesianMotion(component):
    def RunScript(self,
            robot,
            planes: System.Collections.Generic.List[object],
            start_configuration,
            group: str,
            attached_collision_meshes: System.Collections.Generic.List[object],
            path_constraints: System.Collections.Generic.List[object],
            max_step: float,
            compute: bool):
        key = create_id(self, "trajectory")

        max_step = float(max_step) if max_step else 0.01
        path_constraints = list(path_constraints) if path_constraints else None
        attached_collision_meshes = list(attached_collision_meshes) if attached_collision_meshes else None

        if robot and robot.client and robot.client.is_connected and start_configuration and planes and compute:
            frames = [plane_to_compas_frame(plane) for plane in planes]
            frame_waypoints = FrameWaypoints(frames)
            st[key] = robot.plan_cartesian_motion(
                robot,
                frame_waypoints,
                start_configuration=start_configuration,
                group=group,
                options=dict(
                    max_step=max_step,
                    path_constraints=path_constraints,
                    attached_collision_meshes=attached_collision_meshes,
                ),
            )

        trajectory = st.get(key, None)
        return trajectory
# ---------- end plan_cartesian_motion_2 ----------
inverse_kinematics_2 = InverseKinematics(robot=S.robot, plane=py_2, start_configuration=merge_config)  # -> configuration; inputs group: String
#   port plane: The plane or frame to calculate the inverse kinematic for.
#   port start_configuration: If passed, calculates the inverse such that the joint positions differ the least from the start_configuration. Defaults to the zero configuration.
#   port group: The planning group used for calculation. Defaults to the robot's main planning group.
#   port configuration: The planning group's configuration.
# ---------- inverse_kinematics_2: Python ----------
"""
Calculate the robot's inverse kinematic for a given plane.

COMPAS FAB v1.0.2
"""

from compas_rhino.conversions import plane_to_compas_frame
from ghpythonlib.componentbase import executingcomponent as component

from compas_fab.backends.kinematics.analytical_inverse_kinematics import AnalyticalInverseKinematics


class InverseKinematics(component):
    def RunScript(self, robot, plane, start_configuration, group: str):
        configuration = None
        if robot and plane:

            aik = AnalyticalInverseKinematics()
            
            frame = plane_to_compas_frame(plane)
            configuration , a = aik.inverse_kinematics(robot, frame, start_configuration, group)

            print(configuration)
        return configuration
# ---------- end inverse_kinematics_2 ----------
trajectory_visualize = TrajectoryVisualize(trajectory=plan_cartesian_motion_2)  # -> start_configuration, configurations, fraction, time, planes, P, V, A; inputs group: String
#   port group: The planning group for which this trajectory was planned.
#   port trajectory: The calculated trajectory.
#   port start_configuration: The start configuration of the trajectory.
#   port configurations: The full configurations along the trajectory.
#   port fraction: Indicates the fraction of requested trajectory that was calculated, e.g. 1 means the full trajectory was found.
#   port time: The time which is needed to execute that trajectory at full speed.
#   port planes: The planes of the robot's end-effector.
#   port P: The positions along the trajectory
#   port V: The velocities along the trajectory
#   port A: The accelerations along the trajectory
# ---------- trajectory_visualize: Python ----------
"""
Visualizes a trajectory.

COMPAS FAB v1.0.2
"""
import compas_fab
from compas_ghpython.drawing import draw_frame
from compas_ghpython.sets import list_to_ghtree
from ghpythonlib.componentbase import executingcomponent as component


class TrajectoryVisualize(component):
    def RunScript(self, robot, group: str, trajectory):
        start_configuration = None
        configurations = []
        fraction = 0.0
        time = 0.0

        planes = []
        positions = []
        velocities = []
        accelerations = []

        if robot and trajectory:
            group = group or robot.main_group_name

            for c in trajectory.points:
                configurations.append(
                    robot.merge_group_with_full_configuration(c, trajectory.start_configuration, group)
                )
                frame = robot.forward_kinematics(c, group, options=dict(solver="model"))
                planes.append(draw_frame(frame))
                positions.append(c.positions)
                velocities.append(c.velocities)
                accelerations.append(c.accelerations)

            start_configuration = trajectory.start_configuration
            fraction = trajectory.fraction
            time = trajectory.time_from_start

        P = list_to_ghtree(list(zip(*positions)))
        V = list_to_ghtree(list(zip(*velocities)))
        A = list_to_ghtree(list(zip(*accelerations)))

        # return outputs if you have them; here I try it for you:
        return (start_configuration, configurations, fraction, time, planes, P, V, A)
# ---------- end trajectory_visualize ----------
list_item = ListItem(List=inverse_kinematics_2, Index=0, Wrap=True)
point = Point(trajectory_visualize.planes)
time_s = Panel(trajectory_visualize.time)
fraction = Panel(trajectory_visualize.fraction)
pline = PolyLine(Vertices=point, Closed=False)
start = Button()
stop = Button()
preview = CustomPreview(Geometry=pline, Material=ColourSwatch(SwatchColor=RGB(59, 137, 161)))

# ---- group: forward kinematics
a2 = Slider(63, range=-360..360)
a1 = Slider(-71, range=-360..360)
a3 = Slider(-11, range=-360..360)
a4 = Slider(-101, range=-360..360)

# ----
panel_3 = Panel("positions")
prismatic = QuickGraph(trajectory_visualize.P, SortOrder=0)
panel_4 = Panel("velocities")
graph = QuickGraph(trajectory_visualize.V, SortOrder=0)
panel_5 = Panel("accelerations")
graph_2 = QuickGraph(trajectory_visualize.A, SortOrder=0)
script_2 = Script(L=trajectory_visualize.configurations, start=start, stop=stop, interval="20")  # -> out, item; inputs L: list, start: Boolean, stop: Boolean, step: Boolean, back: Boolean, interval: Double
# ---------- script_2: Python ----------
from scriptcontext import sticky as st
from compas_ghpython.timer import update_component

if not interval:
    interval = 5

# store data in component
guid = str(ghenv.Component.InstanceGuid)
counter_key = "counter_" + guid
running_key = "running_" + guid

if counter_key not in st or reset:
    st[counter_key] = 0

if running_key not in st:
    st[running_key] = False




if start:
    st[running_key] = True

if stop:
    st[running_key] = False

if step:
    if st[counter_key] < len(L) - 1:
        st[counter_key] += 1

if back:
    if st[counter_key] > 1:
        st[counter_key] -= 1

if len(L):
    item = L[st[counter_key]]

if st[running_key]:
    if st[counter_key] < len(L) - 1:
        st[counter_key] += 1
        update_component(ghenv, interval)
    else:
        st[counter_key] = 0
        st[running_key] = False
# ---------- end script_2 ----------
panel_6 = Panel(script_2.item)
script_3 = Script(robot=S.robot, a1=a1, a2=a2, a3=a3, a4=a4)  # -> out, full_configuration
# ---------- script_3: Python ----------
import math
import Grasshopper
from compas_robots import Configuration
from compas_robots.model import Joint


if robot:
    joint_positions = [a1, a2, a3, a4]
    joint_types = robot.get_configurable_joint_types(group)
    joint_names = robot.get_configurable_joint_names(group)
    for i, joint_type in enumerate(joint_types):
        if joint_type == Joint.REVOLUTE:
            joint_positions[i] = math.radians(joint_positions[i])
    full_configuration = Configuration(joint_positions, joint_types,joint_names)
# ---------- end script_3 ----------
panel_8 = Panel(script_3.full_configuration)
toggle = BooleanToggle(False)
robot_visualize_2 = RobotVisualize(robot=S.robot, configuration=script_3.full_configuration, show_cm=toggle, show_acm=toggle)  # -> visual, collision, collision_meshes, attached_meshes, frames, base_frame, ee_frame; inputs group: String, show_visual: Boolean, show_collision: Boolean, show_frames: Boolean, show_base_frame: Boolean, show_end_effector_frame: Boolean, show_cm: Boolean, show_acm: Boolean; same code as robot_visualize
panel_9 = Panel(zero_config_2)
content_cache = ContentCache(Name="123", Content=robot_visualize_2.visual, Action=null)  # -> Name, Content, Result
scale_2 = Scale(Geometry=robot_visualize_2.visual, Center=Point(0, 0, 0), Factor=0.5)  # -> Geometry, Transform
custom_preview = CustomPreview(
    Geometry=robot_visualize_2.visual,
    Material={diffuse=RGB(221, 160, 221), emission=RGB(66, 48, 66), shine=0.5, specular=RGB(255, 255, 255), transparency=0})
